# Grasshopper definition points_from_metro_plan.gh (Grasshopper 1.0.7)
# plug-ins: jSwan

panel = Panel("Structural Elements")
curve = Curve([<curve referenced from the Rhino model> x10])

# ---- group: Curve Path Generation for Particles to Follow
divide_curve = DivideCurve(Curve=curve, Count=45, Kinks=False)  # -> Points, Tangents, Parameters
reverse_list = ReverseList(List=divide_curve.Points)
merge = Merge(Data1=divide_curve.Points, Data2=reverse_list)

# ----
panel_2 = Panel("Stairs")
point = Point([<point referenced from the Rhino model> x58])
control_points = ControlPoints(Curve=curve)  # -> Points, Weights, Knots

# ---- group: Construct Domain for Keys of JSON file, each key is a curve index
list_length = ListLength(List=curve)
subtraction = Subtraction(A=list_length, B=1)
construct_domain = ConstructDomain(DomainStart=1, DomainEnd=list_length)
range = Range(Domain=construct_domain, Steps=subtraction)

# ---- group: Flip Points along Y axis to coresspond with P5 Canvas
deconstruct = Deconstruct(Point=divide_curve.Points)  # -> XComponent, YComponent, ZComponent
multiplication = Multiplication(A=deconstruct.YComponent, B=-1)
construct_point = ConstructPoint(XCoordinate=deconstruct.XComponent, YCoordinate=multiplication, ZCoordinate=deconstruct.ZComponent)

# ----
integer = Integer(range)
panel_3 = Panel(integer)
serialize_keys_and_values = SerializeKeysAndValues(Key=graft(panel_3), Value=construct_point)
panel_4 = Panel(construct_point)
panel_5 = Panel(serialize_keys_and_values)
